# Grasshopper definition grow.image.gh (Grasshopper 1.0.7)

slider = Slider(150, range=50..250)
file_path = FilePath()
c_script = CSharpScript(reset=Button(), draw=Toggle(False), image=file_path, width=slider, height=slider)  # -> out, growDots; inputs reset: Boolean, draw: Boolean, image: String, width: Int32, height: Int32; disabled
# ---------- c_script: C# usings ----------
using System.IO;
using System.Linq;
using System.Data;
using System.Drawing;
using System.Reflection;
using System.Windows.Forms;
using System.Xml;
using System.Xml.Linq;
using System.Runtime.InteropServices;

using Rhino.DocObjects;
using Rhino.Collections;
using GH_IO;
using GH_IO.Serialization;
# ---------- c_script: C# ----------
    // Load image.
    Bitmap bitmap = new Bitmap(image);

    // Resize image.
    bitmap = new Bitmap(bitmap, width, height);

    // Define array for output data.
    double[,] brightness = new double[width, height];

    // Harvest brightness data.
    for (int x = 0; x < width; x++)

      for (int y = 0; y < height; y++)
      {
        Color c = bitmap.GetPixel(x, y);
        // Mirror the pixel reading order.
        brightness[x, height - y - 1] = c.GetBrightness();
      }

    // Convert array to list.
    List<double> brightList = ConvertArrayToList(brightness);

    // Remap brigtness values.
    List <double> brightPow = new List <double>();

    for (int i = 0; i < brightList.Count; i++)
    {
      brightPow.Add(Math.Pow(brightList[i], -1));
    }

    // Final list with radius for the dot image.
    List<double> finalRadius = new List<double>();

    for (int i = 0; i < brightPow.Count; i++)
    {
      double mapValue = MapValue(0.0, 2.45, 0.01, 0.45, brightPow[i]);

      if (mapValue > 0.45)
      {
        mapValue = 0.45;
      }
      finalRadius.Add(mapValue);
    }

    // Target/final pixels with circles.
    List<Point3d> circleCenters = new List<Point3d>();
    List<Circle> finalCircles = new List<Circle>();

    for (int i = 0; i < width; i++)
    {
      for (int j = 0; j < height; j++)
      {
        Point3d Points = new Point3d(i, j, 0);
        circleCenters.Add(Points);
      }
    }

    for (int i = 0; i < circleCenters.Count; i++)
    {
      Circle circle = new Circle(circleCenters[i], finalRadius[i]);
      finalCircles.Add(circle);
    }

    // Reset button to start random pixels distribution (radius of circles).
    if (reset)
    {
      randomNum = new List<double>();
      Random randomGenerator = new Random();

      for (int i = 0; i < circleCenters.Count; i++)
      {
        double myRandomNumber = randomGenerator.NextDouble() * 0.2 + 0.1;
        randomNum.Add(myRandomNumber);
      }
      num = randomNum;
      check = new int[width * height];
    }

    // Pixel(circles) pulsing before drawing the final image.
    List<Circle> circles = new List<Circle>();
    List<double> numStop = new List<double>();

    for (int i = 0; i < circleCenters.Count; i++)
    {
      // When the draw button is on, stop pulsing when the pixels are in the correct range.
      if (draw && num[i] >= finalRadius[i] - 0.02 && num[i] <= finalRadius[i] + 0.02) num[i] = finalRadius[i];    //to jest do poprawy, bug z breakIt

        // Pulsing -> Enlarge the circles or make them smaller if they are too big or small.
      else
      {
        if (num[i] >= 0.5) check[i] = 1;
        else if (num[i] <= 0.01) check[i] = 0;

        if (check[i] == 1) num[i] -= 0.01;
        else num[i] += 0.01;
      }
      Circle circle = new Circle(circleCenters[i], num[i]);
      circles.Add(circle);
    }

    growDots = circles;
# ---------- c_script: C# additional code ----------
  // Remember the last data.
  List<double> num = new List<double>();
  List<double> randomNum = new List<double>();
  int[] check = new int[10000];

  private List<double> ConvertArrayToList(double[,] Array)
  {
    int sizeX = Array.GetLength(0);
    int sizeY = Array.GetLength(1);
    List<double> list = new List<double>();

    for (int x = 0; x < sizeX; x++)
    {
      for (int y = 0; y < sizeY; y++)
      {
        list.Add(Array[x, y]);
      }
    }

    return list;
  }

  private double MapValue(double a0, double a1, double b0, double b1, double a)
  {
    /* a = Value to map
       a0 - a1 = source values
       b0 - b1 = target values
    */
    return b0 + (b1 - b0) * ((a - a0) / (a1 - a0));
  }
# ---------- end c_script ----------
timer = Timer(TimerInterval=1, Target=c_script)  # disabled
